# Grasshopper definition demo1.gh (Grasshopper 1.0.7)
# plug-ins: RooFit

point = Point([Point(14.82907972, 13.0750052, 9.485321376), Point(8.634542897, 13.0750052, 9.215993688), Point(5.402610641, 13.0750052, 8.946666), Point(-0.7919261836, 13.0750052, 8.677338312), Point(-4.02385844, 13.0750052, 8.677338312), Point(-7.255790696, 13.0750052, 8.677338312)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])
curve = Curve(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)
roofit_grid = RooFitGrid(Points=point, Density=1)
roofit_preprocess = RooFitPreprocess(Points=roofit_grid, Footprint=curve, Height=0)  # -> Points, Extrusion, Mesh
roofit_analysis = RooFitAnalysis(Mesh=roofit_preprocess.Mesh, Threshold=0.975)  # -> Planes, MeshList_Dev
builder = Builder(
    Points=roofit_preprocess.Points,
    Extrusion=roofit_preprocess.Extrusion,
    Planes=roofit_analysis.Planes,
    Threshold=5,
    TopN=4)
